# Grasshopper definition PolarTest.gh (Grasshopper 1.0.7)

cable_1_length = Slider(873, range=0..2000)
motor_distance = Slider(1000, range=0..2000)
cable_2_length = Slider(852, range=0..2000)
expression = Expression(r1=cable_1_length, r2=cable_2_length, d=motor_distance, Expression="(r1 * r1 - r2 * r2 + d * d)/ (2 * d)")
pt = ConstructPoint(XCoordinate=0, YCoordinate=0, ZCoordinate=0)
pt_2 = ConstructPoint(XCoordinate=motor_distance, YCoordinate=0, ZCoordinate=0)
expression_2 = Expression(r1=cable_1_length, x=expression, Expression="Sqrt(r1 * r1 - x * x)")
# Calculate xy position based on cable length
cir = Circle(Plane=pt, Radius=cable_1_length)
cir_2 = Circle(Plane=pt_2, Radius=cable_2_length)
max = Maximum(A="0", B=expression_2)
max_2 = Maximum(A="0", B=expression)
neg = Negative(Value=max)
one_over_x = OneOverX(Value=motor_distance)
vec = VectorXYZ(XComponent=max_2, YComponent=max, ZComponent=0)  # -> Vector, Length
vec_2 = VectorXYZ(XComponent=max_2, YComponent=neg, ZComponent=0)  # -> Vector, Length
multiplication = Multiplication(A=one_over_x, B=vec.Vector)
addition = Addition(A=pt, B=vec_2.Vector)
panel = Panel(multiplication)
ln = Line(StartPoint=[pt, pt_2], EndPoint=addition)
